# Grasshopper definition tessellation.gh (Grasshopper 0.9.76)
# plug-ins: Python Interpreter

crv = Curve([<curve referenced from the Rhino model> x6])
srf = Surface(<surface referenced from the Rhino model>)
remesh = PythonScript(crvs=crv, srf=srf)  # -> out, mesh; inputs crvs: list of Curve; disabled
# ---------- remesh: Python ----------
import rhinoscriptsyntax as rs

from compas.datastructures import Mesh

from compas.topology import trimesh_remesh
from compas.topology import delaunay_from_points
from compas.topology import mesh_dual

from compas.utilities import geometric_key


from compas_rhino.conduits import MeshConduit

from compas_ghpython.artists import MeshArtist


def sort_pts(sets_pts):
    # sorts point sets for coons patch

    # sort point sets in a "continous chain"
    end_pt = sets_pts[0][-1]
    new_sets_pts = [sets_pts[0]]
    sets_pts.pop(0)

    while True:
        flag = True
        for i, set_pts in enumerate(sets_pts):
            if geometric_key(set_pts[0]) == geometric_key(end_pt):
                end_pt = set_pts[-1]
                new_sets_pts.append(set_pts)
                sets_pts.pop(i)
                flag = False
            elif geometric_key(set_pts[-1]) == geometric_key(end_pt):
                end_pt = set_pts[0]
                set_pts.reverse()
                new_sets_pts.append(set_pts)
                sets_pts.pop(i)
                flag = False

        if flag: break

    return new_sets_pts


# callback function executed inside the smoothing loop
def callback(mesh, k, args):
    if k % 10 == 0:
        rs.Prompt(str(k))

    srf = args[0]

    # constrain all non-fixed to a surface
    for key, attr in mesh.vertices(data=True):
        if key in fixed:
            continue

        x, y, z = rs.BrepClosestPoint(srf, mesh.vertex_coordinates(key))[0]
        attr['x'] = x
        attr['y'] = y
        attr['z'] = z

    conduit.redraw()


if __name__ == '__main__':

    # set the remeshing parameters
    trg_l = 0.65
    kmax = 300

    sets_pts = [
        rs.DivideCurve(crv, round(rs.CurveLength(crv) / trg_l, 0))
        for crv in crvs
    ]

    sets_pts = sort_pts(sets_pts)

    # cull duplicate points
    points = []
    for pts in sets_pts:
        points += pts[1:]

    # construct delaunay mesh
    faces = delaunay_from_points(points, boundary=points)
    mesh = Mesh.from_vertices_and_faces(points, faces)

    # set fixed vertices
    fixed = set(mesh.vertices_on_boundary())

    #    artist = MeshArtist(mesh, layer='delaunay')
    #    artist.draw_faces(join_faces=True)

    conduit = MeshConduit(mesh, refreshrate=2)

    # run remeshing algorithm
    with conduit.enabled():
        trimesh_remesh(
            mesh,
            target=trg_l,
            kmax=kmax,
            tol=0.1,
            divergence=0.01,
            allow_boundary_split=True,
            allow_boundary_swap=True,
            allow_boundary_collapse=False,
            smooth=True,
            fixed=fixed,
            callback=callback,
            callback_args=[srf])

    artist = MeshArtist(mesh)
    mesh = artist.draw_faces(join_faces=True)
# ---------- end remesh ----------
mesh = Mesh(<mesh referenced from the Rhino model>)
dualmesh = PythonScript(mesh=mesh)  # -> out, dual_mesh; inputs mesh: Mesh
# ---------- dualmesh: Python ----------
import compas_rhino

from compas.datastructures import Mesh
from compas_rhino.helpers import mesh_from_guid
from compas_rhino.artists.meshartist import MeshArtist
from compas.topology import mesh_dual

from compas_rhino.geometry import RhinoMesh
from compas_ghpython.artists import MeshArtist


def my_mesh_dual(mesh, cls=None):
    """Construct the dual of a mesh."""
    if not cls:
        cls = type(mesh)

    dual = cls()

    fkey_centroid = {fkey: mesh.face_centroid(fkey) for fkey in mesh.faces()}
    outer = mesh.vertices_on_boundary()
    inner = list(set(mesh.vertices()) - set(outer))
    # print(set(mesh.vertices()))
    # print('vertice', set(mesh.vertices()))
    # print('outer', outer)
    # print('inner', inner)
    vertices = {}
    faces = {}

    # inner faces
    for key in inner:
        fkeys = mesh.vertex_faces(key, ordered=True)
        for fkey in fkeys:
            if fkey not in vertices:
                vertices[fkey] = fkey_centroid[fkey]
        faces[key] = fkeys

    # boundary condition
    for key in outer:
        fkeys = mesh.vertex_faces(key, ordered=True)
        if len(fkeys) > 1:
            for fkey in fkeys:
                if fkey not in vertices:
                    vertices[fkey] = fkey_centroid[fkey]

            vkeys = reversed(mesh.vertex_neighbors(key, ordered=True))
            for i, v in enumerate(vkeys):
                if mesh.is_edge_on_boundary(key, v) and (
                        len(fkey_centroid) * (i + 1) + fkey) not in vertices:
                    vertices[len(fkey_centroid) * (i + 1) +
                             fkey] = mesh.edge_midpoint(key, v)
                    fkeys.append(len(fkey_centroid) * (i + 1) + fkey)

            faces[key] = fkeys

    for key, (x, y, z) in vertices.items():
        dual.add_vertex(key, x=x, y=y, z=z)

    for fkey, vertices in faces.items():
        dual.add_face(vertices, fkey=fkey)

    return dual


if __name__ == '__main__':

    
    mesh = mesh_from_guid(Mesh, mesh)

    # make my own dula mesh with edge condition
    dual = my_mesh_dual(mesh)
    
    artist = MeshArtist(dual)
    dual_mesh = artist.draw_edges()
# ---------- end dualmesh ----------
voussoirinterface = PythonScript(crvs=dualmesh.dual_mesh)  # -> out, interface_m; inputs crvs: list of Curve
# ---------- voussoirinterface: Python ----------
import rhinoscriptsyntax as rs

from compas.datastructures import Mesh

from compas.geometry import scale_vector
from compas.geometry import add_vectors

from compas.geometry import planarize_faces
from compas.geometry import flatness
from compas.utilities import i_to_rgb

from compas_rhino.utilities import get_line_coordinates


def draw_interface(vertices, faces, maxdev):
    # don't refresh viewport
    # rs.EnableRedraw(False)
    # compute level of flatness
    flat_vals = flatness(vertices, faces, maxdev)

    srfs = []
    for i, face in enumerate(faces):
        # vertex coordinates for face
        pts = [vertices[key] for key in face]
        # create Rhino surface
        srfs.append(rs.AddSrfPt(pts))
        # color surface based on flatness
        rgb = i_to_rgb(flat_vals[i])
        # rs.ObjectColor(srfs[-1], rgb)
    
    return srfs
    # rs.AddObjectsToGroup(srfs, rs.AddGroup())
    # refresh viewport
    # rs.EnableRedraw(True)


def callback(k, callback_args=None):
    if k % 5 == 0:
        rs.Prompt('Iteration: {0} '.format(k))

if __name__ == '__main__':

    thickness = 0.2

    edge_crvs = crvs
    lines = get_line_coordinates(edge_crvs)

    mesh = Mesh.from_lines(lines, delete_boundary_face=True)
    
    
    # compute offset points top (a)
    vertices_list = []
    key_index_a = {}
    for i, key in enumerate(mesh.vertices()):
        pt = mesh.vertex_coordinates(key)
        normal = mesh.vertex_normal(key)
        vertices_list.append(
            add_vectors(pt, scale_vector(normal, thickness * .5)))
        # create key_index map top (a)
        key_index_a[key] = i

    # compute offset points bottom (b)
    n = mesh.number_of_vertices()
    key_index_b = {}
    for i, key in enumerate(mesh.vertices()):
        pt = mesh.vertex_coordinates(key)
        normal = mesh.vertex_normal(key)
        vertices_list.append(
            add_vectors(pt, scale_vector(normal, thickness * -.5)))
        # create key_index map bottom (b)
        key_index_b[key] = i + n

    # create faces for interfaces (voussoirs/blocks)
    faces_list = []
    for u, v in mesh.edges():
        faces_list.append(
            [key_index_a[u], key_index_a[v], key_index_b[v], key_index_b[u]])

    # draw and group interfaces
    maxdev = 0.015
    
    
    # interface_m = []
    
    interface_m = draw_interface(vertices_list, faces_list, maxdev)
# ---------- end voussoirinterface ----------
voussoirplanarize = PythonScript(crvs=dualmesh.dual_mesh)  # -> out, interface_m; inputs crvs: list of Curve; disabled
# ---------- voussoirplanarize: Python ----------
import rhinoscriptsyntax as rs

from compas.datastructures import Mesh

from compas.geometry import scale_vector
from compas.geometry import add_vectors

from compas.geometry import planarize_faces
from compas.geometry import flatness
from compas.utilities import i_to_rgb

from compas_rhino.utilities import get_line_coordinates


def draw_interface(vertices, faces, maxdev):
    # don't refresh viewport
    # rs.EnableRedraw(False)
    # compute level of flatness
    flat_vals = flatness(vertices, faces, maxdev)

    srfs = []
    for i, face in enumerate(faces):
        # vertex coordinates for face
        pts = [vertices[key] for key in face]
        # create Rhino surface
        srfs.append(rs.AddSrfPt(pts))
        # color surface based on flatness
        rgb = i_to_rgb(flat_vals[i])
        # rs.ObjectColor(srfs[-1], rgb)
    
    return srfs
    # rs.AddObjectsToGroup(srfs, rs.AddGroup())
    # refresh viewport
    # rs.EnableRedraw(True)


def callback(k, callback_args=None):
    if k % 5 == 0:
        rs.Prompt('Iteration: {0} '.format(k))

if __name__ == '__main__':

    thickness = 0.2

    edge_crvs = crvs
    lines = get_line_coordinates(edge_crvs)

    mesh = Mesh.from_lines(lines, delete_boundary_face=True)
    
    # compute offset points top (a)
    vertices_list = []
    key_index_a = {}
    for i, key in enumerate(mesh.vertices()):
        pt = mesh.vertex_coordinates(key)
        normal = mesh.vertex_normal(key)
        vertices_list.append(
            add_vectors(pt, scale_vector(normal, thickness * .5)))
        # create key_index map top (a)
        key_index_a[key] = i

    # compute offset points bottom (b)
    n = mesh.number_of_vertices()
    key_index_b = {}
    for i, key in enumerate(mesh.vertices()):
        pt = mesh.vertex_coordinates(key)
        normal = mesh.vertex_normal(key)
        vertices_list.append(
            add_vectors(pt, scale_vector(normal, thickness * -.5)))
        # create key_index map bottom (b)
        key_index_b[key] = i + n

    # create faces for interfaces (voussoirs/blocks)
    faces_list = []
    for u, v in mesh.edges():
        faces_list.append(
            [key_index_a[u], key_index_a[v], key_index_b[v], key_index_b[u]])

    # draw and group interfaces
    maxdev = 0.015
    
    
    # interface_m = []
    
    planarize_faces(vertices_list, faces_list, kmax=150, callback=callback)
    interface_m = draw_interface(vertices_list, faces_list, maxdev)
# ---------- end voussoirplanarize ----------
voussoirs = PythonScript(crvs=dualmesh.dual_mesh)  # -> out, voussoirs; inputs crvs: list of Curve
# ---------- voussoirs: Python ----------
import rhinoscriptsyntax as rs

from compas.datastructures import Mesh
from compas.geometry import scale_vector
from compas.geometry import add_vectors
from compas.geometry import planarize_faces
from compas.geometry import bounding_box
from compas_rhino.utilities import get_line_coordinates

from compas_pattern.cad.rhino.utilities import draw_mesh
from compas_ghpython.artists import MeshArtist



def callback(k, callback_args=None):
    if k % 5 == 0:
        rs.Prompt('Iteration: {0} '.format(k))


if __name__ == '__main__':

    meshes = []
    # define min/max shell thickness
    thickness_max = 0.4
    thickness_min = 0.1
    new_z_delta = thickness_max - thickness_min

    # select tessellation
    edge_crvs = crvs
    lines = get_line_coordinates(edge_crvs)

    mesh = Mesh.from_lines(lines, delete_boundary_face=True)

    # find z-max and z-min of the tessellation geomerty
    bb = bounding_box(mesh.get_vertices_attributes(('x', 'y', 'z')))
    print(bb)
    z_max = bb[0][2]
    z_min = bb[4][2]
    z_delta = z_max - z_min

    vertices_list = []
    # compute offset points top (a)
    key_index_a = {}
    for i, key in enumerate(mesh.vertices()):
        pt = mesh.vertex_coordinates(key)
        normal = mesh.vertex_normal(key)
        thickness = (((pt[2] - z_min) * new_z_delta) / z_delta) + thickness_min
        vertices_list.append(
            add_vectors(pt, scale_vector(normal, thickness * .5)))
        # create key_index map top (a)
        key_index_a[key] = i

    # compute offset points bottom (b)
    n = mesh.number_of_vertices()
    key_index_b = {}
    for i, key in enumerate(mesh.vertices()):
        pt = mesh.vertex_coordinates(key)
        normal = mesh.vertex_normal(key)
        thickness = (((pt[2] - z_min) * new_z_delta) / z_delta) + thickness_min
        vertices_list.append(
            add_vectors(pt, scale_vector(normal, thickness * -.5)))
        # create key_index map bottom (b)
        key_index_b[key] = i + n

    # create faces for interfaces (voussoirs/blocks)
    faces_list = []
    for u, v in mesh.edges():
        faces_list.append(
            [key_index_a[u], key_index_a[v], key_index_b[v], key_index_b[u]])

    # planarize interfaces
    if 0:
        planarize_faces(vertices_list, faces_list, kmax=150, callback=callback)
        layer = 'voussoirs_planar'
    else:
        layer = 'voussoirs_ruled'

    # create mesh per voussoir/block
    voussoirs_meshes = {}
    for fkey in mesh.faces():

        # initiate mesh object
        voussoir_mesh = Mesh()
        # loop over edges of face (fkey)
        for u, v in mesh.face_halfedges(fkey):
            # add top vertices of face
            x, y, z = vertices_list[key_index_a[u]]
            voussoir_mesh.add_vertex(key_index_a[u], x=x, y=y, z=z)

            # add bottom vertices of face
            x, y, z = vertices_list[key_index_b[u]]
            voussoir_mesh.add_vertex(key_index_b[u], x=x, y=y, z=z)

            # add interfaces
            face = [
                key_index_a[v], key_index_a[u], key_index_b[u], key_index_b[v]
            ]
            voussoir_mesh.add_face(face)

        # add top and bottom faces
        face_a = [key_index_a[key] for key in mesh.face_vertices(fkey)]
        face_b = [key_index_b[key] for key in mesh.face_vertices(fkey)]
        face_b.reverse()
        voussoir_mesh.add_face(face_a)
        voussoir_mesh.add_face(face_b)

        voussoirs_meshes[fkey] = voussoir_mesh

    # draw all voussoir meshes
    for fkey, voussoir_mesh in voussoirs_meshes.items():
        
        artist = MeshArtist(voussoir_mesh)
        
        meshes.append(artist.draw_faces(join_faces=True))
#        meshes.append(artist.draw()) 
        
        
    voussoirs = meshes
# ---------- end voussoirs ----------
